# Dynamo graph VIIA-detail-type_maatregel.dyn (Dynamo 1.3.2.2480)

# group: LIJST MET KOLOMMEN EN BALKEN
# note: Hier worden de categorieen gekozen en omgezet naar een nieuwe lijst (lis.Create). Deze lijst bestaat dan uit 2 lijsten en worden met de node Flatten platgeslagen tot 1 lijst.
categories = Categories("StructuralFraming")
categories_2 = Categories("StructuralColumns")
create = List.Create(categories, categories_2)
all_elements_of_category = ElementsOfCategory(create)
flatten = Flatten(all_elements_of_category)

# group: INPUT
materiaal_parameter = StringInput("Description")
materiaal_waarde = StringInput("steel")
fase_parameter = StringInput("Phase Created")
fase_waarde = StringInput("3. engineering")
maatregel_parameter = StringInput("detail-type_maatregel")
fase_waarde_2 = StringInput("L5-D")
maatregel_parameter_resetwaarde = StringInput("")
familynaam_parameter = StringInput("Type")

materiaal_parameter_2 = CodeBlock(x=materiaal_parameter) { x; }
materiaal_waarde_2 = CodeBlock(x=materiaal_waarde) { x; }

# group: FILTER OP DESCRIPTION STEEL
# note: Van de elementen uit de kolommen/ligger-lijst wordt de parameter "Description" uitgelezen om te bepalen of het element de waarde "steel" heeft. Als dit zo is wordt er een nieuwe lijst gemaakt met alle elementen waarvan de "Description" "steel" is.
getParameterValueByNameTypeOrInstance = RevitElements.Element.GetParameterValueByNameTypeOrInstance(flatten, materiaal_parameter_2)
allIndicesOf = List.AllIndicesOf(list=getParameterValueByNameTypeOrInstance, item=materiaal_waarde_2)
getItemAtIndex = List.GetItemAtIndex(list=flatten, index=allIndicesOf)

fase_parameter_2 = CodeBlock(x=fase_parameter) { x; }
fase_parameter_3 = CodeBlock(x=fase_parameter_2) { x; }
fase_waarde_3 = CodeBlock(x=fase_waarde) { x; }
fase_waarde_4 = CodeBlock(x=fase_waarde_3) { x; }

# group: FILTERT OP PHASE ENGINEERING
# note: Van alle kolommen/balken in deze lijst wordt de "Phase Created" uitgelezen en vergelijken de String "3. engineering" om de elementen uit deze Phase te selecteren. Op basis van de indexnummers uit List.AllIndicesOf en de node List.GetItemAtIndex wordt een nieuwe lijst gegenereerd met alleen de elementen die in de Phase "3. engineering" zitten.
getParameterValueByName = Element.GetParameterValueByName(element=getItemAtIndex, parameterName=fase_parameter_3)
name = Element.Name(getParameterValueByName)
allIndicesOf_2 = List.AllIndicesOf(list=name, item=fase_waarde_4)
getItemAtIndex_2 = List.GetItemAtIndex(list=getItemAtIndex, index=allIndicesOf_2)

maatregel_parameter_2 = CodeBlock(x=maatregel_parameter) { x; }
discrete_maatregel_code = CodeBlock(x=fase_waarde_2) { x; }

# group: ALLE ELEMENTEN DIE NIET GEFILTERD ZIJN
# note: Alle elementen uit de kolom/ligger-lijst die niet door de selectie zijn als discrete maatregel kunnen door deze node te "unfreezen" gereset worden. Deze moet gefreezed blijven wanneer je geen parameters wilt resetten, of handmatig zal resetten wanneer dit nodig is.
removeItemAtIndex = List.RemoveItemAtIndex(list=getItemAtIndex, indices=allIndicesOf_2)  # frozen

maatregel_parameter_resetwaarde_2 = CodeBlock(x=maatregel_parameter_resetwaarde) { x; }

# group: OUTPUT
setParameterByName = Element.SetParameterByName(element=getItemAtIndex_2, parameterName=maatregel_parameter_2, value=discrete_maatregel_code)
setParameterByName_2 = Element.SetParameterByName(element=removeItemAtIndex, parameterName=maatregel_parameter_2, value=maatregel_parameter_resetwaarde_2)

# group: LIJST MET WANDEN/VLOEREN/DAKEN
# note: Hier worden de categorieen gekozen en omgezet naar een nieuwe lijst (lis.Create). Deze lijst bestaat dan uit 3 lijsten en worden met de node Flatten platgeslagen tot 1 lijst.
categories_3 = Categories("Walls")
categories_4 = Categories("Floors")
categories_5 = Categories("Roofs")
create_2 = List.Create(categories_3, categories_4, categories_5)
all_elements_of_category_2 = ElementsOfCategory(create_2)
flatten_2 = Flatten(all_elements_of_category_2)

# group: FILTERT OP PHASE ENGINEERING
# note: Van alle wanden/vloeren/daken in deze lijst wordt de "Phase Created" uitgelezen en vergelijken de String "3. engineering" om de elementen uit deze Phase te selecteren. Op basis van de indexnummers uit List.AllIndicesOf en de node List.GetItemAtIndex wordt een nieuwe lijst gegenereerd met alleen de elementen die in de Phase "3. engineering" zitten.
getParameterValueByName_2 = Element.GetParameterValueByName(element=flatten_2, parameterName=fase_parameter_2)
name_2 = Element.Name(getParameterValueByName_2)
allIndicesOf_3 = List.AllIndicesOf(list=name_2, item=fase_waarde_3)
getItemAtIndex_3 = List.GetItemAtIndex(list=flatten_2, index=allIndicesOf_3)

# group: EVALUATIE VAN DE TYPE NAME
# note: Hier wordt de typename van de family in stukken geknipt. Dit knippen gebeurt op de plaatsten waar een "_" (underscore) voorkomt. Deze opgeknipte stukjes typename vormen een nieuwe lijst. Per element onstaat een nieuwe lijst met het aantal elementen als dat er delen zijn die er door de "_" konden worden. In dit geval 3 onderdelen per type. Het element dat gecontroleerd wordt staat op de 2e plaats, maar heeft indexnummer 1. (indices beginnen op 0.)
# Vervolgens wordt dit 2e deel vergeleken met een ingegeven string (VIIA). De elementen die aan deze test voldoen, gaan door naar de nieuwe lijst die gegenereerd wordt.
name_3 = Element.Name(getItemAtIndex_3)
filter_1_waarde = StringInput("_")
split = String.Split(name_3, filter_1_waarde)
transpose = List.Transpose(split)
code_block = CodeBlock { 1; }
getItemAtIndex_4 = List.GetItemAtIndex(list=transpose, index=code_block)
string = StringInput("VIIA")
eq = getItemAtIndex_4 == string
boolean = BoolSelector(true)
allIndicesOf_4 = List.AllIndicesOf(list=eq, item=boolean)
getItemAtIndex_5 = List.GetItemAtIndex(list=getItemAtIndex_3, index=allIndicesOf_4)

familynaam_parameter_2 = CodeBlock(x=familynaam_parameter) { x; }

# group: EVALUATIE VAN DE TYPE NAME
# note: Hier wordt de typename uitgesplits en (op een simpele manier) gecontroleerd of hij er als een maatregel uit ziet (of er een streepje voorkomt.) Dit moet verbetert worden om typenames met perongeluk een streepje in de naam uit te filteren. Voorstel is om de naam per character te controleren. Is 1e character een L, is de 2e een cijfer, is de 3e een - (dash) & is de laatste een letter. Als een waarde aan alle 4 de eisen voldoet mag hij meegenomen worden.
getParameterValueByNameTypeOrInstance_2 = RevitElements.Element.GetParameterValueByNameTypeOrInstance(getItemAtIndex_5, familynaam_parameter_2)
string_from_object = FromObject(getParameterValueByNameTypeOrInstance_2)
filter_1_waarde_2 = StringInput("_")
split_2 = String.Split(string_from_object, filter_1_waarde_2)
transpose_2 = List.Transpose(split_2)
code_block_2 = CodeBlock { 2; }
getItemAtIndex_6 = List.GetItemAtIndex(list=transpose_2, index=code_block_2)
filter_1_waarde_3 = StringInput("-")
code_block_3 = CodeBlock { 1; }
boolean_2 = BoolSelector(false)

filter_1_waarde_4 = StringInput("L")
startsWith = String.StartsWith(str=getItemAtIndex_6, searchFor=filter_1_waarde_4)
boolean_3 = BoolSelector(true)
allIndicesOf_5 = List.AllIndicesOf(list=startsWith, item=boolean_3)
getItemAtIndex_7 = List.GetItemAtIndex(list=getItemAtIndex_6, index=allIndicesOf_5)

# group (continued): EVALUATIE VAN DE TYPE NAME
split_3 = String.Split(getItemAtIndex_7, filter_1_waarde_3)
transpose_3 = List.Transpose(split_3)
getItemAtIndex_8 = List.GetItemAtIndex(list=transpose_3, index=code_block_3)
isNull = Object.IsNull(getItemAtIndex_8)
allIndicesOf_6 = List.AllIndicesOf(list=isNull, item=boolean_2)
getItemAtIndex_9 = List.GetItemAtIndex(list=getItemAtIndex_5, index=allIndicesOf_6)
getItemAtIndex_10 = List.GetItemAtIndex(list=getItemAtIndex_7, index=allIndicesOf_6)

maatregel_parameter_3 = CodeBlock(x=maatregel_parameter_2) { x; }

# group: OUTPUT
setParameterByName_3 = Element.SetParameterByName(element=getItemAtIndex_9, parameterName=maatregel_parameter_3, value=getItemAtIndex_10)

author_notes = CodeBlock()
# ---------- author_notes.designscript (20 lines) ----------
/*
++++++++++++++++++++++++++++++++++++++++++++++++++++++++++
Copyright© 2017, Alex Dias Teixeira, VIIA Groningen
alex.dias.teixeira@viiagroningen.nl, +31681335156
++++++++++++++++++++++++++++++++++++++++++++++++++++++++++

Dit script is ontwikkelt voor Dynamo 13.2.2480 en Revit 2017.2
Voordat je het script start moet je de volgende onderdelen controleren:

Dit script is bedoelt om voor de VIIA projecten de instance parameter
"detail-type_maatregel" in te vullen op basis van de typename.
Het script doet dit voor de wanden, vloeren en daken.
Verbindingsmaatregelen (L2) dienen handmatig ingevult worden.

Installeer de volgende packages:
(Packages > Search for packages...)
- Rhythm
-

*/;
# ----------------------------------------
